# Grasshopper definition front_end.gh (Grasshopper 1.0.7)
# plug-ins: MeshEdit Components

panel_2 = Panel("C:\baseline_test_new\input")

radopaquemat = HoneybeePlus_RadianceOpaqueMaterial(name="Context_mat", reflect="0.2", spec=0, rough=0)  # -> material; plug-in component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
context = Brep([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])
hbsurface = HoneybeePlus_HoneybeeSurface(geo=context, names="Context", rad_mat=radopaquemat)  # -> report, HB_srf; plug-in component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

radpargridbased = HoneybeePlus_RadianceParametersGridBased(complexity=Slider(0, range=0..2), recipe_type="1")  # -> report, rad_par, vmtx_par, dmtx_par, smtx_par; plug-in component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
d_matrix = Panel(radpargridbased.dmtx_par)

radpargridbased_2 = HoneybeePlus_RadianceParametersGridBased(complexity=Slider(0, range=0..2), recipe_type="1")  # -> report, rad_par, vmtx_par, dmtx_par, smtx_par; plug-in component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
v_matrix = Panel(radpargridbased_2.vmtx_par)
d_matrix_2 = Panel(radpargridbased_2.dmtx_par)

# ---- group: Ext. walls only
brep = Brep([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])

# ----
area = Area(Geometry=brep)  # -> Area, Centroid
genpts = LBGeneratePointGrid(geometry=brep, grid_size="4", offset_dist="0.05")  # -> points, vectors, face_areas, graft(mesh); plug-in component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
panel_3 = Panel(area.Area)
facen = FaceNormals(Mesh=genpts.mesh)  # -> Centers, Normals
analysisgrid = HoneybeePlus_AnalysisGrid(name="facade_points_88", test_points=genpts.points, pts_vectors=genpts.vectors)  # -> analysis_grid; plug-in component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
vdis = VectorDisplay(Anchor=facen.Centers, Vector=facen.Normals)

# ---- group: Rest of Volume massing
zone = Brep([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])

# ----
hbsurface_2 = HoneybeePlus_HoneybeeSurface(geo=zone)  # -> report, HB_srf; plug-in component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
hbsurface_3 = HoneybeePlus_HoneybeeSurface(geo=brep)  # -> report, HB_srf; plug-in component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

wires = BrepWireframe(Brep=[zone, brep], Density=-1)
# VMT tool input
preview = CustomPreview(Geometry=[zone, brep], Material=ColourSwatch(SwatchColor=RGB(255, 0, 0)))

wires_2 = BrepWireframe(Brep=context, Density=-1)
preview_2 = CustomPreview(Geometry=context, Material=ColourSwatch(SwatchColor=RGB(150, 150, 150)))

panel_4 = Panel("C:\Users\Pedersen_Admin\OneDrive - Perkins and Will\Documents\GitHub\VMT\database\smx\IWEC\Norway\Oslo\NOR_Oslo.Fornebu.014880_IWEC.epw")
wea = HoneybeePlus_WEAFromEPW(epw_file=panel_4)  # -> wea; plug-in component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
skymatrix = HoneybeePlus_SkyMatrix(name="SkyMatrix_88", north=0, wea=wea, density=1)  # -> skymtx; plug-in component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

mesh = Mesh(genpts.mesh)

# ---- group: Export rest of volume massing to rad
panel_5 = Panel("volume_massing_rest.rad")
hbtorad = HoneybeePlus_WriteHBObjectsToRadiance(HB_objects=hbsurface_2.HB_srf, folder=panel_2, file_name=panel_5, write=Toggle(False))  # -> rad_file; plug-in component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
concat = Concatenate(FragmentA=panel_2, FragmentB="\", FragmentC=panel_5)
importrad = Honeybee_ImportRad(radianceFile=concat)  # -> RADMaterials, RADSurfaces; disabled; plug-in component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

# ---- group: Export volume massing to rad
hbtorad_2 = HoneybeePlus_WriteHBObjectsToRadiance(HB_objects=hbsurface_3.HB_srf, folder=panel_2, file_name="volume_massing.rad", write=Toggle(False))  # -> rad_file; plug-in component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
concat_2 = Concatenate(FragmentA=panel_2, FragmentB="\", FragmentC="volume_massing.rad")
importrad_2 = Honeybee_ImportRad(radianceFile=concat_2)  # -> RADMaterials, RADSurfaces; disabled; plug-in component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

# ----
explode = MeshExplode(Mesh=mesh, Interpolate=False)

# ---- group: Export context to rad
hbtorad_3 = HoneybeePlus_WriteHBObjectsToRadiance(HB_objects=hbsurface.HB_srf, folder=panel_2, file_name="context.rad", write=Toggle(False))  # -> rad_file; plug-in component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
concat_3 = Concatenate(FragmentA=panel_2, FragmentB="\", FragmentC="context.rad")
importrad_3 = Honeybee_ImportRad(radianceFile=concat_3)  # -> RADMaterials, RADSurfaces; disabled; plug-in component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

# ----
# Honeybee Radiation Simulation
panel_6 = Panel(explode)
flatten = FlattenTree(Tree=analysisgrid, Path="{0}")

annualradrecipe = HoneybeePlus_AnnualRadiationRecipe(skymtx=skymatrix, analysis_grids=flatten, dmtx_par=radpargridbased_2.dmtx_par, reuse_dmtx="True")  # -> analysis_recipe; plug-in component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

panel_7 = Panel("C:\Users\Pedersen_Admin\OneDrive - Perkins and Will\Desktop\baseline_test")
data = Data([hbsurface_2.HB_srf, hbsurface.HB_srf])
runradiance = HoneybeePlus_RunRadianceAnalysis(
    analysis_recipe=annualradrecipe,
    HB_objects=data,
    folder=panel_7,
    name="HBplus_RADIATION",
    write=Toggle(False),
    run=Toggle(False))  # -> report, legend_par, outputs; plug-in component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

# ----
# VMT tool radiation output
panel_8 = Panel("C:\baseline_test\radiation_analysis")
toggle = BooleanToggle(True)

# ---- group: Data load
panel_9 = Panel("""\output\result_cummulative_0.txt
\output\result_cummulative_1.txt
\output\result_cummulative_2.txt
\output\result_cummulative_3.txt""")
panel_10 = Panel("""\output\clustering_label_0.txt
\output\clustering_label_1.txt
\output\clustering_label_2.txt
\output\clustering_label_3.txt""")
panel_11 = Panel("""\output\clustering_center_0.txt
\output\clustering_center_1.txt
\output\clustering_center_2.txt
\output\clustering_center_3.txt""")
panel_12 = Panel("""\mesh\mesh_0.txt
\mesh\mesh_1.txt
\mesh\mesh_2.txt
\mesh\mesh_3.txt""")
concat_4 = Concatenate(FragmentA=panel_8, FragmentB="\pts\points_all.pts")
concat_5 = Concatenate(FragmentA=panel_8, FragmentB=panel_9)
concat_6 = Concatenate(FragmentA=panel_8, FragmentB=panel_12)
concat_7 = Concatenate(FragmentA=panel_8, FragmentB=panel_10)
concat_8 = Concatenate(FragmentA=panel_8, FragmentB=panel_11)
python = GhPythonScript(all_points_file=concat_4, run=toggle)  # -> out, P, N
# ---------- python: Python ----------
__author__ = "Pedersen_Admin"
__version__ = "2021.02.10"

import rhinoscriptsyntax as rs
import os 

if run:
    P = []
    N = []
    with open(all_points_file, "r") as infile:
        content = infile.readlines()
        
    for i in range(len(content)):
        try:
            numbers = content[i].split(" ")
            print(numbers)
            P.append(rs.AddPoint(float(numbers[0]),float(numbers[1]),float(numbers[2])))
            
            N.append(rs.AddPoint(float(numbers[3]),float(numbers[4]),float(numbers[5])))
            
        except: #Last line
            pass
# ---------- end python ----------
python_2 = GhPythonScript(mesh_files=concat_6, run=toggle)  # -> out, M
# ---------- python_2: Python ----------
__author__ = "Pedersen_Admin"
__version__ = "2021.02.10"

import rhinoscriptsyntax as rs
import os 

if run:
    V = []
    F = []
    with open(mesh_files, "r") as infile:
        content = infile.readlines()
    
    read_vertices = False
    read_fases = False
    for j in range(len(content)):
        
        if "### Mesh vertices" in content[j]:
            read_vertices = True
            read_fases = False
            continue
            
        elif "### Mesh faces" in content[j]:
            read_vertices = False
            read_fases = True
            continue
        
        if read_vertices:
            numbers = content[j].split(" ")
            V.append((float(numbers[0]),
            float(numbers[1]),
            float(numbers[2])))
            
        elif read_fases:
            numbers = content[j].split(" ")
            F.append((int(numbers[0]),
            int(numbers[1]),
            int(numbers[2]),
            int(numbers[3])))
    
    M = rs.AddMesh(V,F) #https://discourse.mcneel.com/t/creating-meshes-from-scratch/22504/2
# ---------- end python_2 ----------
python_3 = GhPythonScript(cummulative_results_file=concat_5, run=toggle)  # -> output
# ---------- python_3: Python ----------
__author__ = "Pedersen_Admin"
__version__ = "2021.02.15"

if run:
    with open(cummulative_results_file, "r") as infile:
        content = infile.readlines()
    
    
    output = []
    for i in range(1,len(content)):
        output.append(float(content[i]))
# ---------- end python_3 ----------
python_4 = GhPythonScript(clustering_centers_files=concat_8, run=toggle)  # -> out, P
# ---------- python_4: Python ----------
__author__ = "Pedersen_Admin"
__version__ = "2021.02.10"

import rhinoscriptsyntax as rs
import os 

if run:
    P = []
    with open(clustering_centers_files, "r") as infile:
        content = infile.readlines()
        
    for i in range(len(content)):
        try:
            numbers = content[i].split(" ")
            P.append(rs.AddPoint(float(numbers[0]),float(numbers[1]),float(numbers[2])))
            #P.append(rs.AddPoint(float(numbers[0]),float(numbers[1])))
            
        except: #Last line
            pass
# ---------- end python_4 ----------
python_5 = GhPythonScript(clustering_files=concat_7, run=toggle)  # -> output
# ---------- python_5: Python ----------
__author__ = "Pedersen_Admin"
__version__ = "2021.02.15"

if run:
    with open(clustering_files, "r") as infile:
        content = infile.readlines()
    
    
    output = []
    for i in range(len(content)):
        output.append(float(content[i]))
# ---------- end python_5 ----------
graft = GraftTree(Tree=python_2.M, IncludeEmptyLists=True, IncludeNullItems=True)

# ----
python_6 = GhPythonScript(folder="C:\baseline_test\rooms", run=toggle)  # -> radfiles
# ---------- python_6: Python ----------
__author__ = "Pedersen_Admin"
__version__ = "2021.02.18"

import rhinoscriptsyntax as rs
import os

if run:
    radfiles = []
    for file in os.listdir(folder):
        radfiles.append(folder + "\\" + file)
# ---------- end python_6 ----------
importrad_4 = Honeybee_ImportRad(radianceFile=python_6)  # -> RADMaterials, RADSurfaces; plug-in component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

panel_13 = Panel(genpts.mesh)
cumvalue = HoneybeePlus_CumulativeValue(analysis_grid=runradiance.outputs)  # -> report, values; plug-in component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

# ----
# Clustering
heatmap = LBSpatialHeatmap(values=python_5, mesh=graft)  # -> mesh, legend, title, colors, legend_par; plug-in component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
flatten_2 = FlattenTree(Tree=python_4.P, Path="{0}")
cluster = Cluster_2(T=python_5)
bang = ExplodeTree(Data=graft)
bang_2 = ExplodeTree(Data=python_5)
heatmap_2 = LBSpatialHeatmap(values=bang_2, mesh=bang, legend_par=cluster)  # -> mesh, legend, title, colors, legend_par; plug-in component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
mesh_2 = Mesh(heatmap.mesh)
dots = DotDisplay(Point=flatten_2, Colour=RGB(0, 0, 0), Size=1)

# ---- group: Cummulative results
cluster_2 = Cluster(T=python_3)
# Cummulative result
heatmap_3 = LBSpatialHeatmap(values=python_3, mesh=graft, legend_par=cluster_2)  # -> mesh, legend, title, colors, legend_par; plug-in component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
bang_3 = ExplodeTree(Data=python_3)
bang_4 = ExplodeTree(Data=graft)
heatmap_4 = LBSpatialHeatmap(values=bang_3, mesh=bang_4, legend_par=cluster_2)  # -> mesh, legend, title, colors, legend_par; plug-in component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
mesh_3 = Mesh(heatmap_3.mesh)
vdis_2 = VectorDisplay(Anchor=python.P, Vector=python.N)

# ----
panel_14 = Panel(cumvalue.values)
flatten_3 = FlattenTree(Tree=cumvalue.values, Path="{0}")
sort = SortList(Keys=flatten_3)  # -> Keys, ValuesA
item = ListItem(List=sort.Keys, Index="-1", Wrap=True)
item_2 = ListItem(List=sort.Keys, Index="0", Wrap=True)
panel_15 = Panel(sort.Keys)
panel_16 = Panel(item_2)
panel_17 = Panel(item)
legendpar = LBLegendParameters(min=item_2, max=item)  # -> leg_par; plug-in component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
heatmap_5 = LBSpatialHeatmap(values=cumvalue.values, mesh=genpts.mesh, legend_par=legendpar)  # -> mesh, legend, title, colors, legend_par; plug-in component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

# ==== cluster Cluster
T = ClusterInput()
flatten = FlattenTree(Tree=T, Path="{0}")
sort = SortList(Keys=flatten)  # -> Keys, ValuesA
item = ListItem(List=sort.Keys, Index="-1", Wrap=True)
item_2 = ListItem(List=sort.Keys, Index="0", Wrap=True)
panel = Panel(item_2)
panel_2 = Panel(item)
legendpar = LBLegendParameters(min=item_2, max=item)  # -> leg_par; plug-in component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
leg_par = ClusterOutput(legendpar)

# ==== cluster Cluster_2
T = ClusterInput()
flatten = FlattenTree(Tree=T, Path="{0}")
sort = SortList(Keys=flatten)  # -> Keys, ValuesA
item = ListItem(List=sort.Keys, Index="-1", Wrap=True)
item_2 = ListItem(List=sort.Keys, Index="0", Wrap=True)
panel = Panel(item_2)
panel_2 = Panel(item)
addition = Addition(A=panel_2, B="1")
legendpar = LBLegendParameters(min=item_2, max=item, seg_count=addition)  # -> leg_par; plug-in component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
leg_par = ClusterOutput(legendpar)
