# Grasshopper definition display_results.gh (Grasshopper 1.0.7)

# ---- group: Read info json
# Input geometry
python = GhPythonScript(info_json="C:\baseline_test_2\info.json")  # -> out, port, vmt_facade_dst, vmt_rest_dst, context_dst, port_2, rad_mesh_files_list, rad_results_cummulative_list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
# ---------- python: Python ----------
__author__ = "Pedersen_Admin"
__version__ = "2021.02.23"

import json

#Read json
with open(info_json, 'r') as infile:
    json_data = json.load(infile)



vmt_facade_dst = json_data["vmt_facade_dst"]
vmt_rest_dst = json_data["vmt_rest_dst"]
context_dst = json_data["context_dst"]

rad_mesh_files_list = json_data["rad_mesh_files_list"]
rad_points_all = json_data["rad_points_all"]

rad_results_cummulative_list = json_data["rad_results_cummulative_list"]

room_folder = json_data["room_folder"]
facade_count = json_data["facade_count"]

day_mesh_path_list = json_data["day_mesh_path_list"]
day_results_da_list = json_data["day_results_da_list"]

ene_cumm_results_list = json_data["ene_cumm_results_list"]
# ---------- end python ----------

# ----
importrad = Honeybee_ImportRad(radianceFile=python.vmt_facade_dst)  # -> RADMaterials, RADSurfaces; plug-in component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
importrad_2 = Honeybee_ImportRad(radianceFile=python.vmt_rest_dst)  # -> RADMaterials, RADSurfaces; plug-in component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
importrad_3 = Honeybee_ImportRad(radianceFile=python.context_dst)  # -> RADMaterials, RADSurfaces; plug-in component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
edges = BrepEdges(Brep=importrad_3.RADSurfaces)  # -> Naked, Interior, NonManifold
edges_2 = BrepEdges(Brep=[importrad.RADSurfaces, importrad_2.RADSurfaces])  # -> Naked, Interior, NonManifold
preview = CustomPreview(Geometry=[importrad.RADSurfaces, importrad_2.RADSurfaces], Material=ColourSwatch(SwatchColor=RGBA(255, 0, 42, 157)))
preview_2 = CustomPreview(Geometry=edges.Naked, Material=ColourSwatch(SwatchColor=RGB(0, 0, 0)))
preview_3 = CustomPreview(Geometry=importrad_3.RADSurfaces, Material=ColourSwatch(SwatchColor=RGBA(255, 255, 255, 226)))

# ---- group: Radiation mesh
# Radiation analysis
python_2 = GhPythonScript(rad_mesh_files_list=python.rad_mesh_files_list)  # -> out, rh_mesh, rh_centroids, rh_normals
# ---------- python_2: Python ----------
__author__ = "Pedersen_Admin"
__version__ = "2021.02.24"

import json
from ladybug_geometry.geometry3d.face import Mesh3D
from ladybug_rhino.fromgeometry import from_mesh3d, from_point3d

with open(rad_mesh_files_list, 'r') as infile:
    mesh_dict = json.load(infile)

lb_mesh = Mesh3D.from_dict(mesh_dict)
rh_mesh = from_mesh3d(lb_mesh)


lb_centroids = lb_mesh.face_centroids
lb_normals = lb_mesh.face_normals

rh_centroids = []
rh_normals = []
for i in range(len(lb_centroids)):
    rh_centroids.append(from_point3d(lb_centroids[i]))
    rh_normals.append(from_point3d(lb_normals[i]))
# ---------- end python_2 ----------
python_3 = GhPythonScript(rad_results_cummulative_list=python.rad_results_cummulative_list)  # -> output
# ---------- python_3: Python ----------
__author__ = "Pedersen_Admin"
__version__ = "2021.02.15"


with open(rad_results_cummulative_list, "r") as infile:
    content = infile.readlines()


output = []
for i in range(len(content)):
    output.append(float(content[i]))
# ---------- end python_3 ----------
graft = GraftTree(Tree=python_2.rh_mesh, IncludeEmptyLists=True, IncludeNullItems=True)

# ---- group: Legend parameters
cluster = Cluster(T=python_3)

# ---- group: Output legend
panel = Panel("""0
0
0""")
path = ConstructPath(Indices=panel)
path_2 = ConstructPath(Indices=panel)
branch = TreeBranch(Tree=python_3, Path=path_2, MaintainPaths=True)
branch_2 = TreeBranch(Tree=graft, Path=path, MaintainPaths=True)
heatmap = LBSpatialHeatmap(values=branch, mesh=branch_2, legend_par=cluster)  # -> mesh, legend, title, colors, legend_par; plug-in component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

# ---- group: Output radiation mesh
heatmap_2 = LBSpatialHeatmap(values=python_3, mesh=graft, legend_par=cluster)  # -> mesh, legend, title, colors, legend_par; plug-in component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
mesh = Mesh(heatmap_2.mesh)

# ---- group: Radiation points
vdis = VectorDisplay(Anchor=python_2.rh_centroids, Vector=python_2.rh_normals)

# ---- group: Room selector
number_slider = Slider(0, range=0..3)

# ----
python_4 = GhPythonScript(room_folder=python.room_folder, surf_id=number_slider)  # -> out, vmx_rooms_rad_files, dmx_rooms_rad_files, room_rad_files
# ---------- python_4: Python ----------
__author__ = "Pedersen_Admin"
__version__ = "2021.02.24"

import rhinoscriptsyntax as rs
from os import listdir
from os.path import isfile, join


vmx_rooms_rad_files = []
dmx_rooms_rad_files = []
room_rad_files = []
for f in listdir(room_folder):
    if ("surf_{}".format(int(surf_id)) in f):
        if "dmx" in f:
            dmx_rooms_rad_files.append(join(room_folder, f))
        elif "vmx" in f:
            vmx_rooms_rad_files.append(join(room_folder, f))
        elif "__room.rad" in f:
            room_rad_files.append(join(room_folder, f))
# ---------- end python_4 ----------
number_of_faces = Panel(python.facade_count)
# Rooms
importrad_4 = Honeybee_ImportRad(radianceFile=python_4.vmx_rooms_rad_files)  # -> RADMaterials, RADSurfaces; plug-in component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
importrad_5 = Honeybee_ImportRad(radianceFile=python_4.dmx_rooms_rad_files)  # -> RADMaterials, RADSurfaces; plug-in component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
importrad_6 = Honeybee_ImportRad(radianceFile=python_4.room_rad_files)  # -> RADMaterials, RADSurfaces; plug-in component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
edges_3 = BrepEdges(Brep=importrad_4.RADSurfaces)  # -> Naked, Interior, NonManifold
edges_4 = BrepEdges(Brep=importrad_5.RADSurfaces)  # -> Naked, Interior, NonManifold
facen = FaceNormals(Mesh=importrad_4.RADSurfaces)  # -> Centers, Normals
edges_5 = BrepEdges(Brep=importrad_6.RADSurfaces)  # -> Naked, Interior, NonManifold
facen_2 = FaceNormals(Mesh=importrad_5.RADSurfaces)  # -> Centers, Normals
facen_3 = FaceNormals(Mesh=importrad_6.RADSurfaces)  # -> Centers, Normals

preview_4 = CustomPreview(Geometry=importrad_4.RADSurfaces, Material=ColourSwatch(SwatchColor=RGB(0, 212, 255)))
vdis_2 = VectorDisplay(Anchor=facen.Centers, Vector=facen.Normals)
preview_5 = CustomPreview(Geometry=edges_3.Naked, Material=ColourSwatch(SwatchColor=RGB(0, 0, 0)))

preview_6 = CustomPreview(Geometry=edges_4.Naked, Material=ColourSwatch(SwatchColor=RGB(0, 0, 0)))
preview_7 = CustomPreview(Geometry=importrad_5.RADSurfaces, Material=ColourSwatch(SwatchColor=RGB(0, 212, 255)))
vdis_3 = VectorDisplay(Anchor=facen_2.Centers, Vector=facen_2.Normals)

vdis_4 = VectorDisplay(Anchor=facen_3.Centers, Vector=facen_3.Normals)
preview_8 = CustomPreview(Geometry=importrad_6.RADSurfaces, Material=ColourSwatch(SwatchColor=RGBA(255, 255, 255, 91)))
preview_9 = CustomPreview(Geometry=edges_5.Naked, Material=ColourSwatch(SwatchColor=RGB(0, 0, 0)))

python_5 = GhPythonScript(day_results_da_list=python.day_results_da_list, surf_id=number_slider)  # -> out, day_results_da; inputs day_results_da_list: list
# ---------- python_5: Python ----------
__author__ = "Pedersen_Admin"
__version__ = "2021.02.24"

import json
from ladybug_geometry.geometry3d.face import Mesh3D
from ladybug_rhino.fromgeometry import from_mesh3d, from_point3d
from os import listdir
from os.path import isfile, join

day_results_da = []
for f in range(len(day_results_da_list)):
    if ("surf_{}".format(int(surf_id)) in day_results_da_list[f]):
        day_results_da.append(day_results_da_list[f])
# ---------- end python_5 ----------

legendpar = LBLegendParameters(min="0", max="100")  # -> leg_par; plug-in component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

python_6 = GhPythonScript(ene_cumm_results_list=python.ene_cumm_results_list, surf_id=number_slider)  # -> out, ene_cumm_results; inputs ene_cumm_results_list: list
# ---------- python_6: Python ----------
__author__ = "Pedersen_Admin"
__version__ = "2021.02.24"

import json
from ladybug_geometry.geometry3d.face import Mesh3D
from ladybug_rhino.fromgeometry import from_mesh3d, from_point3d
from os import listdir
from os.path import isfile, join

ene_cumm_results = []
for f in range(len(ene_cumm_results_list)):
    if ("surf_{}".format(int(surf_id)) in ene_cumm_results_list[f]):
        ene_cumm_results.append(ene_cumm_results_list[f])
# ---------- end python_6 ----------
# Energy analysis
panel_2 = Panel(python_6.ene_cumm_results)

# ---- group: Radiation mesh
# Daylight analysis
python_7 = GhPythonScript(day_mesh_path_list=python.day_mesh_path_list, surf_id=number_slider)  # -> out, day_mesh_path; inputs day_mesh_path_list: list
# ---------- python_7: Python ----------
__author__ = "Pedersen_Admin"
__version__ = "2021.02.24"

import json
from ladybug_geometry.geometry3d.face import Mesh3D
from ladybug_rhino.fromgeometry import from_mesh3d, from_point3d
from os import listdir
from os.path import isfile, join

day_mesh_path = []
for f in range(len(day_mesh_path_list)):
    if ("surf_{}".format(int(surf_id)) in day_mesh_path_list[f]):
        day_mesh_path.append(day_mesh_path_list[f])
# ---------- end python_7 ----------
python_8 = GhPythonScript(day_results_da=python_5.day_results_da)  # -> output
# ---------- python_8: Python ----------
__author__ = "Pedersen_Admin"
__version__ = "2021.02.15"


with open(day_results_da, "r") as infile:
    content = infile.readlines()


output = []
for i in range(len(content)):
    output.append(float(content[i]))
# ---------- end python_8 ----------

# ----
python_9 = GhPythonScript(day_mesh_path=python_7.day_mesh_path)  # -> out, rh_mesh, rh_centroids, rh_normals
# ---------- python_9: Python ----------
__author__ = "Pedersen_Admin"
__version__ = "2021.02.24"

import json
from ladybug_geometry.geometry3d.face import Mesh3D
from ladybug_rhino.fromgeometry import from_mesh3d, from_point3d
from os import listdir
from os.path import isfile, join


with open(day_mesh_path, 'r') as infile:
    mesh_dict = json.load(infile)

lb_mesh = Mesh3D.from_dict(mesh_dict)
rh_mesh = from_mesh3d(lb_mesh)


lb_centroids = lb_mesh.face_centroids
lb_normals = lb_mesh.face_normals

rh_centroids = []
rh_normals = []
for i in range(len(lb_centroids)):
    rh_centroids.append(from_point3d(lb_centroids[i]))
    rh_normals.append(from_point3d(lb_normals[i]))
# ---------- end python_9 ----------

# ---- group: Radiation mesh (continued)
graft_2 = GraftTree(Tree=python_9.rh_mesh, IncludeEmptyLists=True, IncludeNullItems=True)

# ---- group: Daylight points
vdis_5 = VectorDisplay(Anchor=python_9.rh_centroids, Vector=python_9.rh_normals)

# ---- group: Output radiation mesh
heatmap_3 = LBSpatialHeatmap(values=python_8, mesh=graft_2, legend_par=legendpar)  # -> mesh, legend, title, colors, legend_par; plug-in component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

# ==== cluster Cluster
T = ClusterInput()
flatten = FlattenTree(Tree=T, Path="{0}")
sort = SortList(Keys=flatten)  # -> Keys, ValuesA
item = ListItem(List=sort.Keys, Index="-1", Wrap=True)
item_2 = ListItem(List=sort.Keys, Index="0", Wrap=True)
panel = Panel(item_2)
panel_2 = Panel(item)
legendpar = LBLegendParameters(min=item_2, max=item)  # -> leg_par; plug-in component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
leg_par = ClusterOutput(legendpar)
