# Grasshopper definition generate_rad.gh (Grasshopper 1.0.7)

# ---- group: Folder placement of rad files
panel = Panel("C:\Users\Pedersen_Admin\OneDrive - Perkins and Will\Documents\GitHub\VMT\examples\example1")

# ---- group: Volume massing
# VMT tool - geometry to rad
brep = Brep([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])

# ----
context = Brep([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])

# ---- group: Groundplane
context_2 = Brep(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)

# ---- group: Write
toggle = BooleanToggle(False)

# ---- group: Visualize context
wires = BrepWireframe(Brep=[context, context_2], Density=-1)
preview = CustomPreview(Geometry=[context, context_2], Material=ColourSwatch(SwatchColor=RGB(150, 150, 150)))

# ---- group: Visualize volume massing
wires_2 = BrepWireframe(Brep=brep, Density=-1)
preview_2 = CustomPreview(Geometry=brep, Material=ColourSwatch(SwatchColor=RGB(255, 0, 0)))

# ----
cluster = Cluster(volume_massing=brep, write=toggle, groundplane=context_2, folder=panel, context=context)

# ==== cluster Cluster
groundplane = ClusterInput()
volume_massing = ClusterInput()

# ---- group: Groundplane normal check and offset
groundplane_2 = Data(groundplane)
facen = FaceNormals(Mesh=groundplane_2)  # -> Centers, Normals
python = GhPythonScript(groundplane=groundplane_2, groundplane_normal=facen.Normals)  # -> out, ground_surface_correct
# ---------- python: Python ----------
__author__ = "Pedersen_Admin"
__version__ = "2021.02.22"

import rhinoscriptsyntax as rs


if (abs(groundplane_normal[0]) < 1e-10 and
    abs(groundplane_normal[1]) < 1e-10 and
    abs(groundplane_normal[2] - 1) < 1e-10):
        ground_surface_correct = groundplane

else:
    raise Exception("groundplane must have normal (0,0,1)")
# ---------- end python ----------
offset = OffsetSurface(Surface=python.ground_surface_correct, Distance="-0.001", Retrim=True)
facen_2 = FaceNormals(Mesh=offset)  # -> Centers, Normals

# ---- group: Find facades based on normals having zero z-component
volume_massing_2 = Data(volume_massing)
debrep = DeconstructBrep(Brep=volume_massing_2)  # -> Faces, Edges, Vertices
flatten = FlattenTree(Tree=debrep.Faces, Path="{0}")
facen_3 = FaceNormals(Mesh=flatten)  # -> Centers, Normals
flatten_2 = FlattenTree(Tree=facen_3.Normals, Path="{0}")
python_2 = GhPythonScript(normals=flatten_2, surfaces=flatten)  # -> out, facade, rest; inputs normals: list, surfaces: list
# ---------- python_2: Python ----------
__author__ = "Pedersen_Admin"
__version__ = "2021.02.22"

import rhinoscriptsyntax as rs

facade = []
rest = []

for i in range(len(normals)):
    if abs(normals[i][2]) < 1e-10:
        facade.append(surfaces[i])
    else:
        rest.append(surfaces[i])
# ---------- end python_2 ----------
hbsurface = HoneybeePlus_HoneybeeSurface(geo=python_2.rest)  # -> report, HB_srf; plug-in component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
hbsurface_2 = HoneybeePlus_HoneybeeSurface(geo=python_2.facade)  # -> report, HB_srf; plug-in component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

# ----
context = ClusterInput()

context_2 = Data([offset, context])
flatten_3 = FlattenTree(Tree=context_2, Path="{0}")
radopaquemat = HoneybeePlus_RadianceOpaqueMaterial(name="Context_mat", reflect="0.2", spec=0, rough=0)  # -> material; plug-in component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
hbsurface_3 = HoneybeePlus_HoneybeeSurface(geo=flatten_3, names="Context", rad_mat=radopaquemat)  # -> report, HB_srf; plug-in component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

folder = ClusterInput()
write = ClusterInput()

folder_2 = Data(folder)
write_2 = Data(write)

hbtorad = HoneybeePlus_WriteHBObjectsToRadiance(HB_objects=hbsurface_3.HB_srf, folder=folder_2, file_name="context.rad", write=write_2)  # -> rad_file; plug-in component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
hbtorad_2 = HoneybeePlus_WriteHBObjectsToRadiance(HB_objects=hbsurface.HB_srf, folder=folder_2, file_name="volume_massing_rest.rad", write=write_2)  # -> rad_file; plug-in component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
hbtorad_3 = HoneybeePlus_WriteHBObjectsToRadiance(HB_objects=hbsurface_2.HB_srf, folder=folder_2, file_name="volume_massing_facades.rad", write=write_2)  # -> rad_file; plug-in component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
