# Grasshopper definition generate_rad_2.gh (Grasshopper 1.0.7)

# ---- group: Folder placement of rad files
panel = Panel("C:\Users\Pedersen_Admin\OneDrive - Perkins and Will\Documents\GitHub\VMT\examples\example2_1")

# ----
panel_2 = Panel("C:\Users\Pedersen_Admin\OneDrive - Perkins and Will\Desktop\window.rad")
panel_3 = Panel("C:\Users\Pedersen_Admin\OneDrive - Perkins and Will\Desktop\wall_mat polygon wall_0.rad")

# ---- group: Groundplane
context = Brep(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)

# ---- group: Volume massing
# VMT tool - geometry to rad
brep = Brep([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])

# ----
context_2 = Brep([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])
toggle = BooleanToggle(False)

# ---- group: Visualize volume massing
wires = BrepWireframe(Brep=brep, Density=-1)
preview = CustomPreview(Geometry=brep, Material=ColourSwatch(SwatchColor=RGB(255, 0, 0)))

# ---- group: Visualize context
wires_2 = BrepWireframe(Brep=[context_2, context], Density=-1)
preview_2 = CustomPreview(Geometry=[context_2, context], Material=ColourSwatch(SwatchColor=RGB(150, 150, 150)))

# ----
importrad = Honeybee_ImportRad(radianceFile=panel_2)  # -> RADMaterials, RADSurfaces; plug-in component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
importrad_2 = Honeybee_ImportRad(radianceFile=panel_3)  # -> RADMaterials, RADSurfaces; plug-in component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

radopaquemat = HoneybeePlus_RadianceOpaqueMaterial(name="Context_mat", reflect="0.2", spec=0, rough=0)  # -> material; plug-in component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
hbsurface = HoneybeePlus_HoneybeeSurface(geo=brep)  # -> report, HB_srf; plug-in component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
hbsurface_2 = HoneybeePlus_HoneybeeSurface(geo=[context_2, context], names="Context", rad_mat=radopaquemat)  # -> report, HB_srf; plug-in component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
hbtorad = HoneybeePlus_WriteHBObjectsToRadiance(HB_objects=hbsurface.HB_srf, folder=panel, file_name="volume_massing.rad", write=toggle)  # -> rad_file; plug-in component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
hbtorad_2 = HoneybeePlus_WriteHBObjectsToRadiance(HB_objects=hbsurface_2.HB_srf, folder=panel, file_name="context.rad", write=toggle)  # -> rad_file; plug-in component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

brep_2 = Brep(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)
face = HBFace(geo=brep_2)  # -> report, faces; plug-in component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
aperturesbyratio = HBAperturesByRatio(hb_objs=flatten(face.faces))  # -> report, hb_objs; plug-in component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
